# Grasshopper definition sun_building.gh (Grasshopper 1.0.8)
# plug-ins: RhinoCodePluginGH

galapagos = Galapagos(
    fitness=py3_3,
    gene=[number_slider_44, depth_7, number_slider_11, number_slider_12, depth_8, number_slider_40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])

month = Slider(6, range=1..12)
month_2 = Data(month)

# ---- group: General settings
ceiling_reflectance = Slider(0.8, range=0..1)
walls_reflectance = Slider(0.2, range=0..1)
floor_reflectance = Slider(0.3, range=0..1)

# ----
crv = Curve([<curve referenced from the Rhino model> x12])
boundary = BoundarySurfaces(Edges=crv)
srf = Surface(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)
opaquemod = HBOpaqueModifier(name="ground", reflect="0.25")  # -> modifier; plug-in component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
month_3 = Data(month_2)
panel = Panel("""apartmentWestNorthEast
apartmentWestNorth
apartmentNorthEast
apartmentEast
apartmentEastSouth
apartmentEastSouth2
apartmentSouthWest
apartmentSouthWest2
apartmentWest""")
face = HBFace(geo=srf, rad_mod=opaquemod)  # -> report, faces; plug-in component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
pt = ConstructPoint(XCoordinate=0, YCoordinate=0, ZCoordinate="1")
ground = Data(face.faces)
xy = XYPlane(Origin=pt)
number_slider = Slider(0, range=0..1)
number_slider_2 = Slider(0, range=0..1)
number_slider_3 = Slider(0, range=0..1)
number_slider_4 = Slider(0, range=0..1)
number_slider_5 = Slider(0, range=0..1)
number_slider_6 = Slider(0, range=0..1)
number_slider_7 = Slider(0, range=0..1)
number_slider_8 = Slider(0, range=0..1)
number_slider_9 = Slider(0, range=0..1)
number_slider_10 = Slider(0, range=0..1)
number_slider_11 = Slider(1, range=0..1)
number_slider_12 = Slider(0, range=0..1)
number_slider_13 = Slider(0, range=0..1)
number_slider_14 = Slider(0, range=0..1)
number_slider_15 = Slider(0, range=0..1)
number_slider_16 = Slider(0, range=0..1)
number_slider_17 = Slider(0, range=0..1)
number_slider_18 = Slider(0, range=0..1)
number_slider_19 = Slider(1, range=0..1)
number_slider_20 = Slider(0, range=0..1)
truefalse = Python3Script(x=number_slider, y=number_slider_2)  # -> out, a, b
# ---------- truefalse: Python ----------
if x == 1:
    a = 'True'
else:
    a = 'False'

if y == 1:
    b = 'True'
else: b = 'False'
# ---------- end truefalse ----------
number_slider_21 = Slider(0, range=0..1)
number_slider_22 = Slider(0, range=0..1)
number_slider_23 = Slider(0.4, range=0..1)
number_slider_24 = Slider(0, range=0..1)
number_slider_25 = Slider(0, range=0..1)
number_slider_26 = Slider(0.4, range=0..1)
number_slider_27 = Slider(0, range=0..1)
number_slider_28 = Slider(0, range=0..1)
truefalse_2 = Python3Script(x=number_slider_3, y=number_slider_4)  # -> out, a, b; same code as truefalse
truefalse_3 = Python3Script(x=number_slider_5, y=number_slider_6)  # -> out, a, b; same code as truefalse
truefalse_4 = Python3Script(x=number_slider_7, y=number_slider_8)  # -> out, a, b; same code as truefalse
number_slider_29 = Slider(5, range=0..5)
number_slider_30 = Slider(1, range=0..5)
truefalse_5 = Python3Script(x=number_slider_9, y=number_slider_10)  # -> out, a, b; same code as truefalse
py3 = Python3Script(x=number_slider_11, y=number_slider_12)  # -> out, a, b; same code as truefalse
number_slider_31 = Slider(0, range=0..5)
number_slider_32 = Slider(5, range=0..5)
panel_2 = Panel("""roomsStudentNorth
roomsStudentEast
roomsStudentSouth
roomsStudentWest""")
truefalse_6 = Python3Script(x=number_slider_13, y=number_slider_14)  # -> out, a, b; same code as truefalse
apartmentsouthwest2 = Curve([<curve referenced from the Rhino model> x4])
number_slider_33 = Slider(0.4, range=0..1)
panel_3 = Panel("""roomsStudentNorth
roomsStudentEast
roomsStudentSouth
roomsStudentWest""")
list = ValueList({"Vertical": True, "Horizontal": False}, selected="Horizontal")
flipstart = BooleanToggle(False)
apartmentsouthwest = Curve([<curve referenced from the Rhino model> x6])
truefalse_7 = Python3Script(x=number_slider_15, y=number_slider_16)  # -> out, a, b; same code as truefalse
list_2 = ValueList({"Vertical": True, "Horizontal": False}, selected="Horizontal")
flipstart_2 = BooleanToggle(False)
number_slider_34 = Slider(0.4, range=0..1)
list_3 = ValueList({"Vertical": True, "Horizontal": False}, selected="Horizontal")
flipstart_3 = BooleanToggle(False)
depth = Slider(0, range=0..1)
depth_2 = Slider(0, range=0..1)
number_slider_35 = Slider(3, range=0..5)
depth_3 = Slider(0, range=0..1)
apartmentwest = Curve([<curve referenced from the Rhino model> x12])
number_slider_36 = Slider(0.3, range=0..1)
depth_4 = Slider(0, range=0..1)
number_slider_37 = Slider(0.4, range=0..1)
truefalse_8 = Python3Script(x=number_slider_17, y=number_slider_18)  # -> out, a, b; same code as truefalse
truefalse_9 = Python3Script(x=number_slider_19, y=number_slider_20)  # -> out, a, b; same code as truefalse
number_slider_38 = Slider(0.4, range=0..1)
truefalse_10 = Python3Script(x=number_slider_21, y=number_slider_22)  # -> out, a, b; same code as truefalse
truefalse_11 = Python3Script(x=number_slider_24, y=number_slider_25)  # -> out, a, b; same code as truefalse
list_4 = ValueList({"Vertical": True, "Horizontal": False}, selected="Horizontal")
flipstart_4 = BooleanToggle(False)
depth_5 = Slider(0, range=0..1)
studentsouth = Curve([<curve referenced from the Rhino model> x3])
list_5 = ValueList({"Vertical": True, "Horizontal": False}, selected="Horizontal")
flipstart_5 = BooleanToggle(False)
truefalse_12 = Python3Script(x=number_slider_27, y=number_slider_28)  # -> out, a, b; same code as truefalse
number_slider_39 = Slider(5, range=0..5)
panel_4 = Panel("""roomsStudentNorth
roomsStudentEast
roomsStudentWest
roomsStudentSouthEast
roomsStudentSouthWest""")
panel_5 = Panel("""roomsStudentNorth
roomsStudentEast
roomsStudentWest
roomsStudentSouthEast
roomsStudentSouthWest""")
studentwest = Curve([<curve referenced from the Rhino model> x27])
number_slider_40 = Slider(5, range=0..5)
facparam = HBFacadeParameters(north=0, east=0, south=number_slider_23, west=number_slider_23)  # -> fac_par; plug-in component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
number_slider_41 = Slider(5, range=0..5)
facparam_2 = HBFacadeParameters(north=0, east=0, south=0, west=Slider(0.4, range=0..1))  # -> fac_par; plug-in component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
facparam_3 = HBFacadeParameters(north=0, east=0, south=number_slider_26, west=number_slider_26)  # -> fac_par; plug-in component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
number_slider_42 = Slider(5, range=0..5)
item = ListItem(List=panel, Index=Slider(7, range=0..9), Wrap=True)
apartmentwestnortheast = Curve([<curve referenced from the Rhino model> x4])
number_slider_43 = Slider(5, range=0..5)
item_2 = ListItem(List=panel, Index=Slider(8, range=0..9), Wrap=True)
item_3 = ListItem(List=panel, Index=Slider(6, range=0..9), Wrap=True)
number_slider_44 = Slider(4, range=0..5)
list_6 = ValueList({"Vertical": True, "Horizontal": False}, selected="Horizontal")
flipstart_6 = BooleanToggle(False)
facparam_4 = HBFacadeParameters(north=0, east=0, south=Slider(0.3, range=0..1), west=0)  # -> fac_par; plug-in component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
apartmentwestnorth = Curve([<curve referenced from the Rhino model> x6])
list_7 = ValueList({"Vertical": True, "Horizontal": False}, selected="Horizontal")
flipstart_7 = BooleanToggle(False)
depth_6 = Slider(0, range=0..1)
list_8 = ValueList({"Vertical": True, "Horizontal": False}, selected="Horizontal")
flipstart_8 = BooleanToggle(False)
depth_7 = Slider(0, range=0..1)
facparam_5 = HBFacadeParameters(north=0, east=0, south=0, west=Slider(0.3, range=0..1))  # -> fac_par; plug-in component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
list_9 = ValueList({"Vertical": True, "Horizontal": False}, selected="Vertical")
flipstart_9 = BooleanToggle(False)
depth_8 = Slider(0, range=0..1)
number_slider_45 = Slider(5, range=0..5)
student1north = Curve([<curve referenced from the Rhino model> x42])
multiplication = Multiplication(A=number_slider_32, B=10)
multiplication_2 = Multiplication(A=number_slider_30, B=10)
apartmentnortheast = Curve([<curve referenced from the Rhino model> x6])
depth_9 = Slider(0, range=0..1)
student1north_2 = Curve([<curve referenced from the Rhino model> x21])
multiplication_3 = Multiplication(A=number_slider_29, B=10)
depth_10 = Slider(0, range=0..1)
list_10 = ValueList({"Vertical": True, "Horizontal": False}, selected="Horizontal")
flipstart_10 = BooleanToggle(False)
list_11 = ValueList({"Vertical": True, "Horizontal": False}, selected="Horizontal")
flipstart_11 = BooleanToggle(False)
item_4 = ListItem(List=panel_2, Index=Slider(2, range=0..4), Wrap=True)
depth_11 = Slider(0, range=0..1)
apartmenteastsouth = Curve([<curve referenced from the Rhino model> x6])
apartmenteastsouth2 = Curve([<curve referenced from the Rhino model> x4])
item_5 = ListItem(List=panel_3, Index=Slider(3, range=0..4), Wrap=True)
number_slider_46 = Slider(3, range=0..5)
list_12 = ValueList({"Vertical": True, "Horizontal": False}, selected="Horizontal")
flipstart_12 = BooleanToggle(False)
verticalorhorizontal = Data(truefalse_2.a)
list_13 = ValueList({"Vertical": True, "Horizontal": False}, selected="Horizontal")
flipstart_13 = BooleanToggle(False)
depth_12 = Slider(0, range=0..1)
verticalorhorizontal_2 = Data(truefalse.a)
depth_13 = Slider(0, range=0..1)
verticalorhorizontal_3 = Data(truefalse_3.a)
apartmenteast = Curve([<curve referenced from the Rhino model> x12])
multiplication_4 = Multiplication(A=number_slider_31, B=10)
facparam_6 = HBFacadeParameters(north=number_slider_33, east=number_slider_33, south=0, west=number_slider_33)  # -> fac_par; plug-in component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
multiplication_5 = Multiplication(A=number_slider_35, B=10)
facparam_7 = HBFacadeParameters(north=Slider(0.3, range=0..1), east=0, south=0, west=0)  # -> fac_par; plug-in component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
facparam_8 = HBFacadeParameters(north=0, east=Slider(0.3, range=0..1), south=0, west=0)  # -> fac_par; plug-in component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
facparam_9 = HBFacadeParameters(north=number_slider_34, east=0, south=0, west=number_slider_34)  # -> fac_par; plug-in component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
rooms = Curve(apartmentsouthwest2)
windowratio = Data(facparam)
rooms_2 = Curve(apartmentwest)
verticalorhorizontal_4 = Data(truefalse_4.a)
rooms_3 = Curve(apartmentsouthwest)
windowratio_2 = Data(facparam_2)
windowratio_3 = Data(facparam_3)
facparam_10 = HBFacadeParameters(north=number_slider_36, east=number_slider_36, south=0, west=0)  # -> fac_par; plug-in component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
facparam_11 = HBFacadeParameters(north=0, east=number_slider_37, south=number_slider_37, west=0)  # -> fac_par; plug-in component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
item_6 = ListItem(List=panel, Index=Slider(0, range=0..8), Wrap=True)
angle = Data(multiplication)
flipstart_14 = Data(truefalse_2.b)
verticalorhorizontal_5 = Data(truefalse_5.a)
depth_14 = Data(depth_2)
angle_2 = Data(multiplication_2)
name = Data(item)
flipstart_15 = Data(truefalse.b)
flipstart_16 = Data(truefalse_3.b)
depth_15 = Data(depth_3)
depth_16 = Data(depth_4)
item_7 = ListItem(List=panel_4, Index=Slider(0, range=0..4), Wrap=True)
name_2 = Data(item_2)
item_8 = ListItem(List=panel_5, Index=Slider(1, range=0..4), Wrap=True)
angle_3 = Data(multiplication_3)
name_3 = Data(item_3)
item_9 = ListItem(List=panel, Index=Slider(1, range=0..8), Wrap=True)
facparam_12 = HBFacadeParameters(north=0, east=number_slider_38, south=number_slider_38, west=0)  # -> fac_par; plug-in component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
facparam_13 = HBFacadeParameters(north=0, east=Slider(0.4, range=0..1), south=0, west=0)  # -> fac_par; plug-in component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
item_10 = ListItem(List=panel, Index=Slider(2, range=0..4), Wrap=True)
item_11 = ListItem(List=panel, Index=Slider(5, range=0..9), Wrap=True)
rooms_4 = Curve(studentsouth)
windowratio_4 = Data(facparam_4)
multiplication_6 = Multiplication(A=number_slider_41, B=10)
multiplication_7 = Multiplication(A=number_slider_40, B=10)
angle_4 = Data(multiplication_4)
rooms_5 = Curve(studentwest)
windowratio_5 = Data(facparam_5)
item_12 = ListItem(List=panel, Index=Slider(4, range=0..4), Wrap=True)
flipstart_17 = Data(truefalse_4.b)
multiplication_8 = Multiplication(A=number_slider_42, B=10)
depth_17 = Data(depth_5)
item_13 = ListItem(List=panel, Index=Slider(3, range=0..4), Wrap=True)
name_4 = Data(item_4)
multiplication_9 = Multiplication(A=number_slider_43, B=10)
flipstart_18 = Data(truefalse_5.b)
depth_18 = Data(depth)
angle_5 = Data(multiplication_5)
multiplication_10 = Multiplication(A=number_slider_39, B=10)
name_5 = Data(item_5)
multiplication_11 = Multiplication(A=number_slider_45, B=10)
merge = Merge(Data1=panel_3, Data2=panel)
verticalorhorizontal_6 = Data(truefalse_6.a)
verticalorhorizontal_7 = Data(py3.a)
number_slider_47 = Slider(0.11, range=0..1)
verticalorhorizontal_8 = Data(truefalse_7.a)
multiplication_12 = Multiplication(B=10)
verticalorhorizontal_9 = Data(truefalse_8.a)
verticalorhorizontal_10 = Data(truefalse_9.a)
verticalorhorizontal_11 = Data(truefalse_11.a)
multiplication_13 = Multiplication(A=number_slider_46, B=10)
rooms_6 = Curve(apartmentwestnortheast)
verticalorhorizontal_12 = Data(truefalse_12.a)
windowratio_6 = Data(facparam_6)
rooms_7 = Curve(student1north_2)
windowratio_7 = Data(facparam_7)
verticalorhorizontal_13 = Data(truefalse_10.a)
rooms_8 = Curve(student1north)
windowratio_8 = Data(facparam_8)
angle_6 = Data(multiplication_6)
rooms_9 = Curve(apartmentwestnorth)
flipstart_19 = Data(truefalse_6.b)
windowratio_9 = Data(facparam_9)
depth_19 = Data(depth_6)
flipstart_20 = Data(py3.b)
depth_20 = Data(depth_7)
angle_7 = Data(multiplication_7)
flipstart_21 = Data(truefalse_7.b)
name_6 = Data(item_6)
depth_21 = Data(depth_8)
name_7 = Data(item_7)
rooms_10 = Curve(apartmentnortheast)
name_8 = Data(item_8)
angle_8 = Data(multiplication_8)
windowratio_10 = Data(facparam_10)
rooms_11 = Curve(apartmenteastsouth2)
flipstart_22 = Data(truefalse_8.b)
windowratio_11 = Data(facparam_11)
depth_22 = Data(depth_9)
angle_9 = Data(multiplication_9)
name_9 = Data(item_9)
angle_10 = Data(multiplication_10)
flipstart_23 = Data(truefalse_9.b)
depth_23 = Data(depth_10)
angle_11 = Data(multiplication_11)
name_10 = Data(item_10)
rooms_12 = Curve(apartmenteastsouth)
windowratio_12 = Data(facparam_12)
flipstart_24 = Data(truefalse_11.b)
depth_24 = Data(depth_11)
rooms_13 = Curve(apartmenteast)
windowratio_13 = Data(facparam_13)
name_11 = Data(item_11)
angle_12 = Data(multiplication_12)
flipstart_25 = Data(truefalse_12.b)
depth_25 = Data(depth_12)
flipstart_26 = Data(truefalse_10.b)
depth_26 = Data(depth_13)
name_12 = Data(item_12)
name_13 = Data(item_13)
angle_13 = Data(multiplication_13)
ground_2 = Data(ground)
vizall = HBVisualizeAll(hb_objs=flatten(ground_2))  # -> geo; plug-in component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
panel_6 = Panel("""0.17
0.19
2.48
1.67
0.65
1.06
0.16
0.14
1.24
0.49
2.34
2.19
2.31""")

# ---- group: General settings
panel_7 = Panel("https://climate.onebuilding.org/WMO_Region_6_Europe/NLD_Netherlands/ZH_Zuid-Holland/NLD_ZH_Valkenburg.AP.062100_TMYx.2004-2018.zip")
windows_visual_transmittance = Slider(0.7, range=0..1)
windows_g_value = Slider(1, range=0..1)
downloadepw = LBDownloadWeather(weather_URL=panel_7)  # -> epw_file, stat_file, ddy_file; plug-in component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
gridsize = Slider(0.6, range=0..1)
opaquemod_2 = HBOpaqueModifier(name="balconies", reflect="0.2")  # -> modifier; plug-in component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
number_slider_48 = Slider(-30, range=-180..180)
tauclearsky = HBTauClearSkyFromSTAT(stat_file=downloadepw.stat_file, timestep="1")  # -> wea; plug-in component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
panel_8 = Panel("ext wall")
face_2 = HBFace(geo=boundary, rad_mod=opaquemod_2)  # -> report, faces; plug-in component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
day_default_21 = Integer(21)
legendpar = LBLegendParameters(min=Slider(0, range=0..100), max=Slider(5.5, range=0..10))  # -> leg_par; plug-in component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
opaquemod_3 = HBOpaqueModifier(name="ceil", reflect=ceiling_reflectance)  # -> modifier; plug-in component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
opaquemod_4 = HBOpaqueModifier(name="floor", reflect=floor_reflectance)  # -> modifier; plug-in component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
constrloc = LBConstructLocation(name="Buidling", latitude="52.020523", longitude=" 4.366074", elevation=0)  # -> location; plug-in component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
heightrooms = Data("3")
windowgvalue = Data(windows_g_value)
windowvisualtransmittance = Data(windows_visual_transmittance)
gridsize_2 = Data(gridsize)
compass = LBCompass(north=number_slider_48)  # -> compass; plug-in component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
analysisperiod = LBAnalysisPeriod(start_month=month_3, start_day=day_default_21, start_hour=0, end_month=month_3, end_day=day_default_21)  # -> period, hoys, dates; plug-in component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
decnstrwea = HBDeconstructWea(wea=tauclearsky)  # -> dir, diff, glob; plug-in component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
balconies = Data(face_2.faces)
interiorsubset = HBInteriorModifierSubset(ceiling=opaquemod_3, interior_floor=opaquemod_4)  # -> interior_set; plug-in component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
skymatrix = LBCumulativeSkyMatrix(
    north=number_slider_48,
    location=constrloc,
    direct_rad=decnstrwea.dir,
    diffuse_rad=decnstrwea.diff,
    hoys=analysisperiod.hoys)  # -> report, sky_mtx; plug-in component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
skymtx = Data(skymatrix.sky_mtx)

# ----
opaquemod_5 = HBOpaqueModifier(name=panel_8, reflect=walls_reflectance)  # -> modifier; plug-in component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
exteriorsubset = HBExteriorModifierSubset(exterior_wall=opaquemod_5)  # -> exterior_set; plug-in component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
legendpar_2 = Data(legendpar)
legendpar_3 = Data(legendpar)
sunpath = LBSunPath(north=number_slider_48, location=constrloc, hoys=analysisperiod.hoys, scale=Slider(1.3, range=1..3))  # -> report, vectors, altitudes, azimuths, hoys, sun_pts, analemma, daily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; plug-in component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

# ---- group: General settings (continued)
modifierset = HBModifierSet(name="custom", exterior_subset=exteriorsubset, interior_subset=interiorsubset)  # -> mod_set; plug-in component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
opaqueintext = Data(modifierset)
sph = Sphere(Base=sunpath.sun_pts, Radius=Slider(5, range=0..10))

# ----
southwest = SouthWest_2(
    heightrooms=heightrooms,
    opaqueintext=opaqueintext,
    rooms=apartmentsouthwest2,
    name=name,
    windowratio=windowratio,
    depth=depth_2,
    angle=angle_2,
    verticalorhorizontal=verticalorhorizontal,
    flipstart=flipstart_14,
    legendpar=legendpar_2,
    windowvisualtransmittance=windowvisualtransmittance)  # -> totalarea_2, roomsmodel, aperturesgeometry, legendpar_3, aperturesmodel, facemodel
southwest_2 = SouthWest(
    heightrooms=heightrooms,
    opaqueintext=opaqueintext,
    rooms=apartmentsouthwest,
    name=name_3,
    windowratio=windowratio_3,
    depth=depth_4,
    angle=angle,
    verticalorhorizontal=verticalorhorizontal_3,
    flipstart=flipstart_16,
    legendpar=legendpar_2,
    windowvisualtransmittance=windowvisualtransmittance)  # -> totalarea_2, roomsmodel, aperturesgeometry, legendpar_3, aperturesmodel, facemodel
cluster = Cluster(
    heightrooms=heightrooms,
    opaqueintext=opaqueintext,
    rooms=studentsouth,
    name=name_4,
    windowratio=windowratio_4,
    depth=depth_5,
    angle=angle_4,
    verticalorhorizontal=verticalorhorizontal_4,
    flipstart=flipstart_17,
    legendpar=legendpar_2,
    windowvisualtransmittance=windowvisualtransmittance)  # -> totalarea_2, roomsmodel, aperturesgeometry, legendpar_3, aperturesmodel, facemodel
cluster_2 = Cluster(
    heightrooms=heightrooms,
    opaqueintext=opaqueintext,
    rooms=apartmentwest,
    name=name_2,
    windowratio=windowratio_2,
    depth=depth_3,
    angle=angle_3,
    verticalorhorizontal=verticalorhorizontal_2,
    flipstart=flipstart_15,
    legendpar=legendpar_2,
    windowvisualtransmittance=windowvisualtransmittance)  # -> totalarea_2, roomsmodel, aperturesgeometry, legendpar_3, aperturesmodel, facemodel
cluster_3 = Cluster(
    heightrooms=heightrooms,
    opaqueintext=opaqueintext,
    rooms=studentwest,
    name=name_5,
    windowratio=windowratio_5,
    depth=depth,
    angle=angle_5,
    verticalorhorizontal=verticalorhorizontal_5,
    flipstart=flipstart_18,
    legendpar=legendpar_2,
    windowvisualtransmittance=windowvisualtransmittance)  # -> totalarea_2, roomsmodel, aperturesgeometry, legendpar_3, aperturesmodel, facemodel
cluster_4 = Cluster(
    heightrooms=heightrooms,
    opaqueintext=opaqueintext,
    rooms=apartmentwestnortheast,
    name=name_6,
    windowratio=windowratio_6,
    depth=depth_6,
    angle=angle_6,
    verticalorhorizontal=verticalorhorizontal_6,
    flipstart=flipstart_19,
    legendpar=legendpar_2,
    windowvisualtransmittance=windowvisualtransmittance)  # -> totalarea_2, roomsmodel, aperturesgeometry, legendpar_3, aperturesmodel, facemodel
cluster_5 = Cluster(
    heightrooms=heightrooms,
    opaqueintext=opaqueintext,
    rooms=student1north_2,
    name=name_7,
    windowratio=windowratio_7,
    depth=depth_7,
    angle=angle_12,
    verticalorhorizontal=verticalorhorizontal_7,
    flipstart=flipstart_20,
    legendpar=legendpar_2,
    windowvisualtransmittance=windowvisualtransmittance)  # -> totalarea_2, roomsmodel, aperturesgeometry, legendpar_3, aperturesmodel, facemodel
cluster_6 = Cluster(
    heightrooms=heightrooms,
    opaqueintext=opaqueintext,
    rooms=student1north,
    name=name_8,
    windowratio=windowratio_8,
    depth=depth_8,
    angle=angle_7,
    verticalorhorizontal=verticalorhorizontal_8,
    flipstart=flipstart_21,
    legendpar=legendpar_2,
    windowvisualtransmittance=windowvisualtransmittance)  # -> totalarea_2, roomsmodel, aperturesgeometry, legendpar_3, aperturesmodel, facemodel
cluster_7 = Cluster(
    heightrooms=heightrooms,
    opaqueintext=opaqueintext,
    rooms=apartmentwestnorth,
    name=name_9,
    windowratio=windowratio_9,
    depth=depth_9,
    angle=angle_8,
    verticalorhorizontal=verticalorhorizontal_9,
    flipstart=flipstart_22,
    legendpar=legendpar_2,
    windowvisualtransmittance=windowvisualtransmittance)  # -> totalarea_2, roomsmodel, aperturesgeometry, legendpar_3, aperturesmodel, facemodel
cluster_8 = Cluster(
    heightrooms=heightrooms,
    opaqueintext=opaqueintext,
    rooms=apartmentnortheast,
    name=name_10,
    windowratio=windowratio_10,
    depth=depth_10,
    angle=angle_9,
    verticalorhorizontal=verticalorhorizontal_10,
    flipstart=flipstart_23,
    legendpar=legendpar_2,
    windowvisualtransmittance=windowvisualtransmittance)  # -> totalarea_2, roomsmodel, aperturesgeometry, legendpar_3, aperturesmodel, facemodel
eastsouth1 = EastSouth1(
    heightrooms=heightrooms,
    opaqueintext=opaqueintext,
    rooms=rooms_11,
    name=name_11,
    windowratio=windowratio_11,
    depth=depth_11,
    angle=angle_11,
    verticalorhorizontal=verticalorhorizontal_11,
    flipstart=flipstart_24,
    legendpar=legendpar_2,
    windowvisualtransmittance=windowvisualtransmittance)  # -> totalarea_2, roomsmodel, aperturesgeometry, legendpar_3, aperturesmodel, flatten(facemodel)
eastsouth = EastSouth(
    heightrooms=heightrooms,
    opaqueintext=opaqueintext,
    rooms=apartmenteastsouth,
    name=name_12,
    windowratio=windowratio_12,
    depth=depth_12,
    angle=angle_13,
    verticalorhorizontal=verticalorhorizontal_12,
    flipstart=flipstart_25,
    legendpar=legendpar_2,
    windowvisualtransmittance=windowvisualtransmittance)  # -> totalarea_2, roomsmodel, aperturesgeometry, legendpar_3, aperturesmodel, flatten(facemodel)
cluster_9 = Cluster(
    heightrooms=heightrooms,
    opaqueintext=opaqueintext,
    rooms=apartmenteast,
    name=name_13,
    windowratio=windowratio_13,
    depth=depth_13,
    angle=angle_10,
    verticalorhorizontal=verticalorhorizontal_13,
    flipstart=flipstart_26,
    legendpar=legendpar_2,
    windowvisualtransmittance=windowvisualtransmittance)  # -> totalarea_2, roomsmodel, aperturesgeometry, legendpar_3, aperturesmodel, facemodel
model = HBModel(rooms=flatten(southwest.roomsmodel), faces=flatten(southwest.facemodel), apertures=flatten(southwest.aperturesmodel))  # -> report, model; plug-in component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
area = Area(Geometry=southwest.aperturesgeometry)  # -> Area, Centroid
model_2 = HBModel(rooms=flatten(cluster_2.roomsmodel), faces=flatten(cluster_2.facemodel), apertures=flatten(cluster_2.aperturesmodel))  # -> report, model; plug-in component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
model_3 = HBModel(
    rooms=flatten(southwest_2.roomsmodel),
    faces=flatten(southwest_2.facemodel),
    apertures=flatten(southwest_2.aperturesmodel))  # -> report, model; plug-in component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
area_2 = Area(Geometry=cluster_2.aperturesgeometry)  # -> Area, Centroid
area_3 = Area(Geometry=southwest_2.aperturesgeometry)  # -> Area, Centroid
balconies_2 = Data(balconies)
model_4 = HBModel(rooms=flatten(cluster.roomsmodel), faces=flatten(cluster.facemodel), apertures=flatten(cluster.aperturesmodel))  # -> report, model; plug-in component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
model_5 = HBModel(rooms=flatten(cluster_3.roomsmodel), faces=flatten(cluster_3.facemodel), apertures=flatten(cluster_3.aperturesmodel))  # -> report, model; plug-in component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
area_4 = Area(Geometry=cluster_3.aperturesgeometry)  # -> Area, Centroid
ma = MassAddition(Input=area.Area)  # -> Result, PartialResults
area_5 = Area(Geometry=cluster.aperturesgeometry)  # -> Area, Centroid
ma_2 = MassAddition(Input=area_2.Area)  # -> Result, PartialResults
ma_3 = MassAddition(Input=area_3.Area)  # -> Result, PartialResults
area_6 = Area(Geometry=cluster_5.aperturesgeometry)  # -> Area, Centroid
vizall_2 = HBVisualizeAll(hb_objs=flatten(balconies_2))  # -> geo; plug-in component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
area_7 = Area(Geometry=cluster_4.aperturesgeometry)  # -> Area, Centroid
model_6 = HBModel(rooms=flatten(cluster_4.roomsmodel), faces=flatten(cluster_4.facemodel), apertures=flatten(cluster_4.aperturesmodel))  # -> report, model; plug-in component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
area_8 = Area(Geometry=cluster_7.aperturesgeometry)  # -> Area, Centroid
area_9 = Area(Geometry=cluster_6.aperturesgeometry)  # -> Area, Centroid
panel_9 = Panel(eastsouth1.facemodel)
model_7 = HBModel(rooms=flatten(cluster_6.roomsmodel), faces=flatten(cluster_6.facemodel), apertures=flatten(cluster_6.aperturesmodel))  # -> report, model; plug-in component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
model_8 = HBModel(rooms=flatten(cluster_7.roomsmodel), faces=flatten(cluster_7.facemodel), apertures=flatten(cluster_7.aperturesmodel))  # -> report, model; plug-in component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
panel_10 = Panel(eastsouth.facemodel)
model_9 = HBModel(rooms=flatten(cluster_5.roomsmodel), faces=flatten(cluster_5.facemodel), apertures=flatten(cluster_5.aperturesmodel))  # -> report, model; plug-in component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
model_10 = HBModel(rooms=flatten(cluster_8.roomsmodel), faces=flatten(cluster_8.facemodel), apertures=flatten(cluster_8.aperturesmodel))  # -> report, model; plug-in component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
model_11 = HBModel(rooms=flatten(eastsouth1.roomsmodel), faces=flatten(eastsouth1.facemodel), apertures=flatten(eastsouth1.aperturesmodel))  # -> report, model; plug-in component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
ma_4 = MassAddition(Input=area_4.Area)  # -> Result, PartialResults
model_12 = HBModel(rooms=flatten(eastsouth.roomsmodel), faces=flatten(eastsouth.facemodel), apertures=flatten(eastsouth.aperturesmodel))  # -> report, model; plug-in component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
model_13 = HBModel(rooms=flatten(cluster_9.roomsmodel), faces=flatten(cluster_9.facemodel), apertures=flatten(cluster_9.aperturesmodel))  # -> report, model; plug-in component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
area_10 = Area(Geometry=eastsouth1.aperturesgeometry)  # -> Area, Centroid
area_11 = Area(Geometry=cluster_8.aperturesgeometry)  # -> Area, Centroid
area_12 = Area(Geometry=cluster_9.aperturesgeometry)  # -> Area, Centroid
ma_5 = MassAddition(Input=area_5.Area)  # -> Result, PartialResults
area_13 = Area(Geometry=eastsouth.aperturesgeometry)  # -> Area, Centroid
totalwindowarea = Data(ma.Result)
ma_6 = MassAddition(Input=area_6.Area)  # -> Result, PartialResults
ma_7 = MassAddition(Input=area_7.Area)  # -> Result, PartialResults
vizall_3 = HBVisualizeAll(hb_objs=flatten(model.model))  # -> geo; plug-in component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
totalwindowarea_2 = Data(ma_2.Result)
vizall_4 = HBVisualizeAll(hb_objs=flatten(model_2.model))  # -> geo; plug-in component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
vizall_5 = HBVisualizeAll(hb_objs=flatten(model_3.model))  # -> geo; plug-in component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
totalwindowarea_3 = Data(ma_3.Result)
ma_8 = MassAddition(Input=area_8.Area)  # -> Result, PartialResults
ma_9 = MassAddition(Input=area_9.Area)  # -> Result, PartialResults
vizall_6 = HBVisualizeAll(hb_objs=flatten(model_4.model))  # -> geo; plug-in component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
totalwindowarea_4 = Data(ma_4.Result)
ma_10 = MassAddition(Input=area_10.Area)  # -> Result, PartialResults
ma_11 = MassAddition(Input=area_11.Area)  # -> Result, PartialResults
ma_12 = MassAddition(Input=area_12.Area)  # -> Result, PartialResults
vizall_7 = HBVisualizeAll(hb_objs=flatten(model_5.model))  # -> geo; plug-in component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
ma_13 = MassAddition(Input=area_13.Area)  # -> Result, PartialResults
totalwindowarea_5 = Data(ma_5.Result)
totalwindowarea_6 = Data(ma_6.Result)
totalwindowarea_7 = Data(ma_7.Result)
totalwindowarea_8 = Data(ma_8.Result)
totalwindowarea_9 = Data(ma_9.Result)
vizall_8 = HBVisualizeAll(hb_objs=flatten(model_6.model))  # -> geo; plug-in component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
vizall_9 = HBVisualizeAll(hb_objs=flatten(model_9.model))  # -> geo; plug-in component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
vizall_10 = HBVisualizeAll(hb_objs=flatten(model_7.model))  # -> geo; plug-in component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
vizall_11 = HBVisualizeAll(hb_objs=flatten(model_8.model))  # -> geo; plug-in component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
vizall_12 = HBVisualizeAll(hb_objs=flatten(model_13.model))  # -> geo; plug-in component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
vizall_13 = HBVisualizeAll(hb_objs=flatten(model_10.model))  # -> geo; plug-in component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
vizall_14 = HBVisualizeAll(hb_objs=flatten(model_11.model))  # -> geo; plug-in component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
totalwindowarea_10 = Data(ma_11.Result)
totalwindowarea_11 = Data(ma_12.Result)
totalwindowarea_12 = Data(ma_10.Result)
vizall_15 = HBVisualizeAll(hb_objs=flatten(model_12.model))  # -> geo; plug-in component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
merge_2 = Merge(
    Data1=vizall_9,
    Data2=vizall,
    Data3=vizall_10,
    Data4=vizall_6,
    Data5=vizall_7,
    Data6=vizall_8,
    Data7=vizall_11,
    Data8=vizall_13,
    Data9=vizall_12,
    Data10=vizall_15,
    Data11=vizall_14,
    Data12=vizall_5,
    Data13=vizall_3,
    Data14=vizall_4,
    Data15=vizall_2)
totalwindowarea_13 = Data(ma_13.Result)
context = Data(merge_2)
deconstructmodel = HBDeconstructModel(model=model_9.model)  # -> rooms; plug-in component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
deconstructmodel_2 = HBDeconstructModel(model=model_7.model)  # -> rooms; plug-in component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
deconstructmodel_3 = HBDeconstructModel(model=model_4.model)  # -> rooms; plug-in component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
deconstructmodel_4 = HBDeconstructModel(model=model_5.model)  # -> rooms; plug-in component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
lng = ListLength(List=deconstructmodel)
deconstructmodel_5 = HBDeconstructModel(model=model_2.model)  # -> rooms; plug-in component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
deconstructmodel_6 = HBDeconstructModel(model=model.model)  # -> rooms; plug-in component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
deconstructmodel_7 = HBDeconstructModel(model=model_6.model)  # -> rooms; plug-in component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
lng_2 = ListLength(List=deconstructmodel_2)
deconstructmodel_8 = HBDeconstructModel(model=model_3.model)  # -> rooms; plug-in component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
context_2 = Data(context)
deconstructmodel_9 = HBDeconstructModel(model=model_11.model)  # -> rooms; plug-in component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
skymtx_2 = Data(skymtx)
gridsize_3 = Data(gridsize_2)
skymtx_3 = Data(skymtx)
gridsize_4 = Data(gridsize_2)
skymtx_4 = Data(skymtx)
gridsize_5 = Data(gridsize_2)
lng_3 = ListLength(List=deconstructmodel_3)
context_3 = Data(context)
deconstructmodel_10 = HBDeconstructModel(model=model_8.model)  # -> rooms; plug-in component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
deconstructmodel_11 = HBDeconstructModel(model=model_12.model)  # -> rooms; plug-in component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
context_4 = Data(context)
lng_4 = ListLength(List=deconstructmodel_4)
deconstructmodel_12 = HBDeconstructModel(model=model_13.model)  # -> rooms; plug-in component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
skymtx_5 = Data(skymtx)
gridsize_6 = Data(gridsize_2)
deconstructmodel_13 = HBDeconstructModel(model=model_10.model)  # -> rooms; plug-in component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
context_5 = Data(context)
skymtx_6 = Data(skymtx)
gridsize_7 = Data(gridsize_2)
context_6 = Data(context)
lng_5 = ListLength(List=deconstructmodel_5)
lng_6 = ListLength(List=deconstructmodel_6)
lng_7 = ListLength(List=deconstructmodel_7)
context_7 = Data(context)
context_8 = Data(context)
skymtx_7 = Data(skymtx)
context_9 = Data(context)
gridsize_8 = Data(gridsize_2)
skymtx_8 = Data(skymtx)
gridsize_9 = Data(gridsize_2)
skymtx_9 = Data(skymtx)
gridsize_10 = Data(gridsize_2)
skymtx_10 = Data(skymtx)
gridsize_11 = Data(gridsize_2)
lng_8 = ListLength(List=deconstructmodel_8)
skymtx_11 = Data(skymtx)
gridsize_12 = Data(gridsize_2)
context_10 = Data(context)
skymtx_12 = Data(skymtx)
gridsize_13 = Data(gridsize_2)
context_11 = Data(context)
skymtx_13 = Data(skymtx)
gridsize_14 = Data(gridsize_2)
lng_9 = ListLength(List=deconstructmodel_9)
skymtx_14 = Data(skymtx)
gridsize_15 = Data(gridsize_2)
context_12 = Data(context)
context_13 = Data(context)
context_14 = Data(context)

incidentradiation = LBIncidentRadiation(
    sky_mtx=skymtx_2,
    geometry=flatten(southwest.aperturesgeometry),
    context=flatten(context_3),
    grid_size=gridsize_3,
    offset_dist=0.01,
    legend_par=southwest.legendpar_3,
    parallel=True,
    run=Toggle(True))  # -> report, points, results, total, mesh, legend, title, int_mtx; plug-in component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
incidentradiation_2 = LBIncidentRadiation(
    sky_mtx=skymtx_3,
    geometry=flatten(cluster_2.aperturesgeometry),
    context=flatten(context_2),
    grid_size=gridsize_4,
    offset_dist=0.01,
    legend_par=cluster_2.legendpar_3,
    parallel=True,
    run=Toggle(True))  # -> report, points, results, total, mesh, legend, title, int_mtx; plug-in component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
incidentradiation_3 = LBIncidentRadiation(
    sky_mtx=skymtx_4,
    geometry=flatten(southwest_2.aperturesgeometry),
    context=flatten(context_4),
    grid_size=gridsize_5,
    offset_dist=0.01,
    legend_par=southwest_2.legendpar_3,
    parallel=True,
    run=Toggle(True))  # -> report, points, results, total, mesh, legend, title, int_mtx; plug-in component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
incidentradiation_4 = LBIncidentRadiation(
    sky_mtx=skymtx_5,
    geometry=flatten(cluster.aperturesgeometry),
    context=flatten(context_5),
    grid_size=gridsize_6,
    offset_dist=0.01,
    legend_par=cluster.legendpar_3,
    parallel=True,
    run=Toggle(True))  # -> report, points, results, total, mesh, legend, title, int_mtx; plug-in component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
incidentradiation_5 = LBIncidentRadiation(
    sky_mtx=skymtx_6,
    geometry=flatten(cluster_3.aperturesgeometry),
    context=flatten(context_6),
    grid_size=gridsize_7,
    offset_dist=0.01,
    legend_par=cluster_3.legendpar_3,
    parallel=True,
    run=Toggle(True))  # -> report, points, results, total, mesh, legend, title, int_mtx; plug-in component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
incidentradiation_6 = LBIncidentRadiation(
    sky_mtx=skymtx_7,
    geometry=flatten(cluster_4.aperturesgeometry),
    context=flatten(context_9),
    grid_size=gridsize_8,
    offset_dist=0.01,
    legend_par=cluster_4.legendpar_3,
    parallel=True,
    run=Toggle(True))  # -> report, points, results, total, mesh, legend, title, int_mtx; plug-in component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
incidentradiation_7 = LBIncidentRadiation(
    sky_mtx=skymtx_8,
    geometry=flatten(cluster_5.aperturesgeometry),
    context=flatten(context_7),
    grid_size=gridsize_9,
    offset_dist=0.01,
    legend_par=cluster_5.legendpar_3,
    parallel=True,
    run=Toggle(True))  # -> report, points, results, total, mesh, legend, title, int_mtx; plug-in component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
incidentradiation_8 = LBIncidentRadiation(
    sky_mtx=skymtx_9,
    geometry=flatten(cluster_6.aperturesgeometry),
    context=flatten(context_8),
    grid_size=gridsize_10,
    offset_dist=0.01,
    legend_par=cluster_6.legendpar_3,
    parallel=True,
    run=Toggle(True))  # -> report, points, results, total, mesh, legend, title, int_mtx; plug-in component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
incidentradiation_9 = LBIncidentRadiation(
    sky_mtx=skymtx_10,
    geometry=flatten(cluster_7.aperturesgeometry),
    context=flatten(context_10),
    grid_size=gridsize_11,
    offset_dist=0.01,
    legend_par=cluster_7.legendpar_3,
    parallel=True,
    run=Toggle(True))  # -> report, points, results, total, mesh, legend, title, int_mtx; plug-in component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
incidentradiation_10 = LBIncidentRadiation(
    sky_mtx=skymtx_11,
    geometry=flatten(cluster_8.aperturesgeometry),
    context=flatten(context_11),
    grid_size=gridsize_12,
    offset_dist=0.01,
    legend_par=cluster_8.legendpar_3,
    parallel=True,
    run=Toggle(True))  # -> report, points, results, total, mesh, legend, title, int_mtx; plug-in component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
incidentradiation_11 = LBIncidentRadiation(
    sky_mtx=skymtx_12,
    geometry=flatten(eastsouth1.aperturesgeometry),
    context=flatten(context_12),
    grid_size=gridsize_13,
    offset_dist=0.01,
    legend_par=eastsouth1.legendpar_3,
    parallel=True,
    run=Toggle(True))  # -> report, points, results, total, mesh, legend, title, int_mtx; plug-in component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
incidentradiation_12 = LBIncidentRadiation(
    sky_mtx=skymtx_13,
    geometry=flatten(eastsouth.aperturesgeometry),
    context=flatten(context_14),
    grid_size=gridsize_14,
    offset_dist=0.01,
    legend_par=eastsouth.legendpar_3,
    parallel=True,
    run=Toggle(True))  # -> report, points, results, total, mesh, legend, title, int_mtx; plug-in component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
incidentradiation_13 = LBIncidentRadiation(
    sky_mtx=skymtx_14,
    geometry=flatten(cluster_9.aperturesgeometry),
    context=flatten(context_13),
    grid_size=gridsize_15,
    offset_dist=0.01,
    legend_par=cluster_9.legendpar_3,
    parallel=True,
    run=Toggle(True))  # -> report, points, results, total, mesh, legend, title, int_mtx; plug-in component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

lng_10 = ListLength(List=deconstructmodel_10)
lng_11 = ListLength(List=deconstructmodel_11)
lng_12 = ListLength(List=deconstructmodel_12)
lng_13 = ListLength(List=deconstructmodel_13)
windowgvalue_2 = Data(windowgvalue)
windowgvalue_3 = Data(windowgvalue)
windowgvalue_4 = Data(windowgvalue)
windowgvalue_5 = Data(windowgvalue)
windowgvalue_6 = Data(windowgvalue)
results = Data(incidentradiation.results)
results_2 = Data(incidentradiation_2.results)
results_3 = Data(incidentradiation_3.results)
windowgvalue_7 = Data(windowgvalue)
multiplication_14 = Multiplication(A=incidentradiation.total, B=windowgvalue_2)
results_4 = Data(incidentradiation_4.results)
multiplication_15 = Multiplication(A=incidentradiation_2.total, B=windowgvalue_3)
multiplication_16 = Multiplication(A=incidentradiation_3.total, B=windowgvalue_4)
windowgvalue_8 = Data(windowgvalue)
totalarea = Data(totalwindowarea)
results_5 = Data(incidentradiation_5.results)
windowgvalue_9 = Data(windowgvalue)
total = Data(incidentradiation.total)
division = Division(A=total, B=lng_6)
panel_11 = Panel(division)
totalarea_2 = Data(totalwindowarea_2)
totalarea_3 = Data(totalwindowarea_3)
total_2 = Data(incidentradiation_2.total)
division_2 = Division(A=total_2, B=lng_5)
panel_12 = Panel(division_2)
total_3 = Data(incidentradiation_3.total)
division_3 = Division(A=total_3, B=lng_8)
panel_13 = Panel(division_3)
windowgvalue_10 = Data(windowgvalue)
windowgvalue_11 = Data(windowgvalue)
windowgvalue_12 = Data(windowgvalue)
multiplication_17 = Multiplication(A=incidentradiation_4.total, B=windowgvalue_6)
windowgvalue_13 = Data(windowgvalue)
windowgvalue_14 = Data(windowgvalue)
totalarea_4 = Data(totalwindowarea_5)
multiplication_18 = Multiplication(A=incidentradiation_5.total, B=windowgvalue_5)
total_4 = Data(incidentradiation_4.total)
division_4 = Division(A=total_4, B=lng_3)
panel_14 = Panel(division_4)
totalarea_5 = Data(totalwindowarea_4)
total_5 = Data(incidentradiation_5.total)
division_5 = Division(A=total_5, B=lng_4)
panel_15 = Panel(division_5)
results_6 = Data(incidentradiation_6.results)
results_7 = Data(incidentradiation_7.results)
results_8 = Data(incidentradiation_8.results)
results_9 = Data(incidentradiation_9.results)
division_6 = Division(A=multiplication_14, B=totalarea)
division_7 = Division(A=multiplication_15, B=totalarea_2)
division_8 = Division(A=multiplication_16, B=totalarea_3)
results_10 = Data(incidentradiation_10.results)
results_11 = Data(incidentradiation_11.results)
results_12 = Data(incidentradiation_12.results)
multiplication_19 = Multiplication(A=incidentradiation_6.total, B=windowgvalue_8)
results_13 = Data(incidentradiation_13.results)
multiplication_20 = Multiplication(A=incidentradiation_7.total, B=windowgvalue_9)
multiplication_21 = Multiplication(A=incidentradiation_8.total, B=windowgvalue_7)
multiplication_22 = Multiplication(A=incidentradiation_9.total, B=windowgvalue_11)
totalarea_6 = Data(totalwindowarea_7)
totalarea_7 = Data(totalwindowarea_6)
totalarea_8 = Data(totalwindowarea_9)
total_6 = Data(incidentradiation_6.total)
division_9 = Division(A=total_6, B=lng_7)
panel_16 = Panel(division_9)
total_7 = Data(incidentradiation_7.total)
division_10 = Division(A=total_7, B=lng)
panel_17 = Panel(division_10)
total_8 = Data(incidentradiation_8.total)
division_11 = Division(A=total_8, B=lng_2)
panel_18 = Panel(division_11)
division_12 = Division(A=multiplication_17, B=totalarea_4)
totalarea_9 = Data(totalwindowarea_8)
multiplication_23 = Multiplication(A=incidentradiation_10.total, B=windowgvalue_10)
multiplication_24 = Multiplication(A=incidentradiation_11.total, B=windowgvalue_12)
division_13 = Division(A=multiplication_18, B=totalarea_5)
total_9 = Data(incidentradiation_9.total)
division_14 = Division(A=total_9, B=lng_10)
panel_19 = Panel(division_14)
totalarea_10 = Data(totalwindowarea_10)
total_10 = Data(incidentradiation_10.total)
division_15 = Division(A=total_10, B=lng_13)
panel_20 = Panel(division_15)
totalarea_11 = Data(totalwindowarea_12)
multiplication_25 = Multiplication(A=incidentradiation_12.total, B=windowgvalue_13)
total_11 = Data(incidentradiation_11.total)
division_16 = Division(A=total_11, B=lng_9)
panel_21 = Panel(division_16)
multiplication_26 = Multiplication(A=incidentradiation_13.total, B=windowgvalue_14)
totalarea_12 = Data(totalwindowarea_13)
totalarea_13 = Data(totalwindowarea_11)
total_12 = Data(incidentradiation_12.total)
division_17 = Division(A=total_12, B=lng_11)
panel_22 = Panel(division_17)
persquaremetre = Data(division_6)
total_13 = Data(incidentradiation_13.total)
division_18 = Division(A=total_13, B=lng_12)
panel_23 = Panel(division_18)
persquaremetre_2 = Data(division_7)
persquaremetre_3 = Data(division_8)
division_19 = Division(A=multiplication_19, B=totalarea_6)
division_20 = Division(A=multiplication_20, B=totalarea_7)
division_21 = Division(A=multiplication_21, B=totalarea_8)
division_22 = Division(A=multiplication_22, B=totalarea_9)
persquaremetre_4 = Data(division_12)
persquaremetre_5 = Data(division_13)
division_23 = Division(A=multiplication_23, B=totalarea_10)
division_24 = Division(A=multiplication_24, B=totalarea_11)
division_25 = Division(A=multiplication_25, B=totalarea_12)
division_26 = Division(A=multiplication_26, B=totalarea_13)
persquaremetre_6 = Data(division_19)
persquaremetre_7 = Data(division_20)
persquaremetre_8 = Data(division_21)
persquaremetre_9 = Data(division_22)
persquaremetre_10 = Data(division_23)
persquaremetre_11 = Data(division_24)
panel_24 = Panel(results)
persquaremetre_12 = Data(division_25)
persquaremetre_13 = Data(division_26)
panel_25 = Panel(results_2)
panel_26 = Panel(results_3)

# ---- group: Results
# daily total irradiation [kWh]
panel_27 = Panel(total)

# daily total irradiation [kWh]
panel_28 = Panel(total_2)

# daily total irradiation [kWh]
panel_29 = Panel(total_3)

# ----
# daily total irradiation per square meter [kWh/m2]
panel_30 = Panel(persquaremetre)
# daily total irradiation per square meter [kWh/m2]
panel_31 = Panel(persquaremetre_2)
# daily total irradiation per square meter [kWh/m2]
panel_32 = Panel(persquaremetre_3)
panel_33 = Panel(results_4)

# ---- group: Results
# daily total irradiation [kWh]
panel_34 = Panel(total_4)

# ----
panel_35 = Panel(results_5)

# ---- group: Results
# daily total irradiation [kWh]
panel_36 = Panel(total_5)

# ----
# daily total irradiation per square meter [kWh/m2]
panel_37 = Panel(persquaremetre_5)
# daily total irradiation per square meter [kWh/m2]
panel_38 = Panel(persquaremetre_4)
# daily total irradiation per square meter [kWh/m2]
panel_39 = Panel(persquaremetre_8)
panel_40 = Panel(results_7)
# daily total irradiation per square meter [kWh/m2]
panel_41 = Panel(persquaremetre_6)
panel_42 = Panel(results_6)
panel_43 = Panel(results_8)

# ---- group: Results
# daily total irradiation [kWh]
panel_44 = Panel(total_6)

# ----
# daily total irradiation per square meter [kWh/m2]
panel_45 = Panel(persquaremetre_9)

# ---- group: Results
# daily total irradiation [kWh]
panel_46 = Panel(total_7)

# ----
# daily total irradiation per square meter [kWh/m2]
panel_47 = Panel(persquaremetre_7)

# ---- group: Results
# daily total irradiation [kWh]
panel_48 = Panel(total_8)

# ----
panel_49 = Panel(results_9)

# ---- group: Results
# daily total irradiation [kWh]
panel_50 = Panel(total_9)

# ----
panel_51 = Panel(results_10)
panel_52 = Panel(results_11)

# ---- group: Results
# daily total irradiation [kWh]
panel_53 = Panel(total_10)

# daily total irradiation [kWh]
panel_54 = Panel(total_11)

# ----
# daily total irradiation per square meter [kWh/m2]
panel_55 = Panel(persquaremetre_13)
panel_56 = Panel(results_12)
panel_57 = Panel(results_13)

# ---- group: Results
# daily total irradiation [kWh]
panel_58 = Panel(total_12)

# ----
# daily total irradiation per square meter [kWh/m2]
panel_59 = Panel(persquaremetre_10)

# ---- group: Results
# daily total irradiation [kWh]
panel_60 = Panel(total_13)

# ----
# daily total irradiation per square meter [kWh/m2]
panel_61 = Panel(persquaremetre_11)
# daily total irradiation per square meter [kWh/m2]
panel_62 = Panel(persquaremetre_12)
bar_graph = BarGraph(results, BarColor=RGB(255, 0, 90))
bar_graph_2 = BarGraph(results_2, BarColor=RGB(255, 0, 90))
bar_graph_3 = BarGraph(results_3, BarColor=RGB(255, 0, 90))
bar_graph_4 = BarGraph(results_4, BarColor=RGB(255, 0, 90))
bar_graph_5 = BarGraph(results_5, BarColor=RGB(255, 0, 90))
bar_graph_6 = BarGraph(results_6, BarColor=RGB(255, 0, 90))
bar_graph_7 = BarGraph(results_9, BarColor=RGB(255, 0, 90))
bar_graph_8 = BarGraph(results_7, BarColor=RGB(255, 0, 90))
bar_graph_9 = BarGraph(results_8, BarColor=RGB(255, 0, 90))
bar_graph_10 = BarGraph(results_10, BarColor=RGB(255, 0, 90))
bar_graph_11 = BarGraph(results_11, BarColor=RGB(255, 0, 90))
bar_graph_12 = BarGraph(results_12, BarColor=RGB(255, 0, 90))
bar_graph_13 = BarGraph(results_13, BarColor=RGB(255, 0, 90))
merge_3 = Merge(
    Data1=results_7,
    Data2=results_8,
    Data3=results_4,
    Data4=results_5,
    Data5=results_6,
    Data6=results_9,
    Data7=results_10,
    Data8=results_13,
    Data9=results_12,
    Data10=results_11,
    Data11=results_3,
    Data12=results,
    Data13=results_2)
total_results = Data(merge_3)
total_results_2 = Data(flatten(total_results))
null = NullItem(Item=total_results_2)  # -> NullFlags, InvalidFlags, Description
dispatch = Dispatch(List=total_results_2, DispatchPattern=null.NullFlags)  # -> ListA, ListB
createlegend = LBCreateLegend(values=dispatch.ListB, base_plane=xy, legend_par=legendpar)  # -> mesh, title_obj, label_objs, label_text, colors; plug-in component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
py3_2 = Python3Script(x=total_results)  # -> out, minimum, maximum; inputs x: list
# ---------- py3_2: Python ----------
minimum = round(min(x), 2)
maximum = round(max(x), 2)
# ---------- end py3_2 ----------
panel_63 = Panel([py3_2.minimum, py3_2.maximum])
merge_4 = Merge(
    Data1=panel_17,
    Data2=panel_18,
    Data3=panel_14,
    Data4=panel_15,
    Data5=panel_16,
    Data6=panel_19,
    Data7=panel_20,
    Data8=panel_23,
    Data9=panel_22,
    Data10=panel_21,
    Data11=panel_13,
    Data12=panel_11,
    Data13=panel_12)  # -> flatten(Result)
merge_5 = Merge(
    Data1=panel_47,
    Data2=panel_39,
    Data3=panel_38,
    Data4=panel_37,
    Data5=panel_41,
    Data6=panel_45,
    Data7=panel_59,
    Data8=panel_55,
    Data9=panel_62,
    Data10=panel_61,
    Data11=panel_32,
    Data12=panel_30,
    Data13=panel_31)
dti_room = Panel(merge_4)
dti_m2 = Panel(merge_5)
py3_3 = Python3Script(x=panel_6, y=dti_m2)  # -> out, a; inputs x: list, y: list
# ---------- py3_3: Python ----------
import ghpythonlib.components as gh

def calculate_squared_difference(x, y):
    # Convert elements to floats
    x = [float(i) for i in x]
    y = [float(j) for j in y]

    if len(x) == len(y):
        differences = [a - b for a, b in zip(x, y)]
        squared_differences = [diff ** 2 for diff in differences]
        a = sum(squared_differences)
    else:
        a = 0
    return a

a = calculate_squared_difference(x, y)
# ---------- end py3_3 ----------

# ==== cluster Cluster
verticalorhorizontal = ClusterInput()
rooms = ClusterInput()
windowratio = ClusterInput()
name = ClusterInput()
legendpar = ClusterInput()
flipstart = ClusterInput()
depth = ClusterInput()
angle = ClusterInput()
verticalorhorizontal_2 = Data(verticalorhorizontal)
rooms_2 = Curve(rooms)
windowratio_2 = Data(windowratio)
name_2 = Data(name)
legendpar_2 = Data(legendpar)
flipstart_2 = Data(flipstart)
depth_2 = Data(depth)
angle_2 = Data(angle)
heightrooms = ClusterInput()
legendpar_3 = ClusterOutput(legendpar_2)
student1north = Curve(rooms_2)
heightrooms_2 = Data(heightrooms)
Z = UnitZ(Factor=heightrooms_2)
area = Area(Geometry=student1north)  # -> Area, Centroid
extr = Extrude(Base=student1north, Direction=Z)
opaqueintext = ClusterInput()
cap = CapHoles(Brep=extr)
ma = MassAddition(Input=area.Area)  # -> Result, PartialResults
opaqueintext_2 = Data(opaqueintext)
totalarea = Data(ma.Result)
roomsolid = HBRoomFromSolid(geo=flatten(cap), name=name_2, mod_set=opaqueintext_2, conditioned=True)  # -> report, rooms; plug-in component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
totalarea_2 = ClusterOutput(totalarea)
roomsmodel = ClusterOutput(roomsolid.rooms)
decnstrobj = HBDeconstructObject(hb_obj=roomsolid.rooms)  # -> faces, apertures, doors, shades; plug-in component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
number_slider = Slider(1, range=0..8)
aperturesbyratio = HBAperturesByRatio(hb_objs=flatten(decnstrobj.faces), ratio=windowratio_2)  # -> report, hb_objs; plug-in component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
facemodel = ClusterOutput(aperturesbyratio.hb_objs)
windowvisualtransmittance = ClusterInput()
decnstrobj_2 = HBDeconstructObject(hb_obj=aperturesbyratio.hb_objs)  # -> faces, apertures, doors, shades; plug-in component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
verticalorhorizontal_3 = Data(verticalorhorizontal_2)
angle_3 = Data(angle_2)
depth_3 = Data(depth_2)
flipstart_3 = Data(flipstart_2)
louvershades = HBLouverShades(
    hb_objs=flatten(decnstrobj_2.apertures),
    depth=depth_3,
    angle=angle_3,
    vertical=verticalorhorizontal_3,
    flip_start=flipstart_3)  # -> report, hb_objs; plug-in component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
windowvisualtransmittance_2 = Data(windowvisualtransmittance)
glassmod = HBGlassModifier(name="window", trans=windowvisualtransmittance_2)  # -> modifier; plug-in component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
vizall = HBVisualizeAll(hb_objs=flatten(decnstrobj_2.apertures))  # -> geo; plug-in component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
vizall_2 = HBVisualizeAll(hb_objs=flatten(louvershades.hb_objs))  # -> geo; plug-in component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
applywindowmod = HBApplyWindowModifier(hb_objs=flatten(louvershades.hb_objs), mod=glassmod)  # -> hb_objs; plug-in component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
aperturesgeometry = ClusterOutput(vizall)
aperturesmodel = ClusterOutput(applywindowmod)

# ==== cluster EastSouth
verticalorhorizontal = ClusterInput()
rooms = ClusterInput()
windowratio = ClusterInput()
name = ClusterInput()
legendpar = ClusterInput()
flipstart = ClusterInput()
depth = ClusterInput()
angle = ClusterInput()
verticalorhorizontal_2 = Data(verticalorhorizontal)
rooms_2 = Curve(rooms)
windowratio_2 = Data(windowratio)
name_2 = Data(name)
legendpar_2 = Data(legendpar)
flipstart_2 = Data(flipstart)
depth_2 = Data(depth)
angle_2 = Data(angle)
heightrooms = ClusterInput()
legendpar_3 = ClusterOutput(legendpar_2)
student1north = Curve(rooms_2)
heightrooms_2 = Data(heightrooms)
Z = UnitZ(Factor=heightrooms_2)
area = Area(Geometry=student1north)  # -> Area, Centroid
extr = Extrude(Base=student1north, Direction=Z)
opaqueintext = ClusterInput()
cap = CapHoles(Brep=extr)
ma = MassAddition(Input=area.Area)  # -> Result, PartialResults
opaqueintext_2 = Data(opaqueintext)
totalarea = Data(ma.Result)
roomsolid = HBRoomFromSolid(geo=flatten(cap), name=name_2, mod_set=opaqueintext_2, conditioned=True)  # -> report, rooms; plug-in component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
totalarea_2 = ClusterOutput(totalarea)
roomsmodel = ClusterOutput(roomsolid.rooms)
decnstrobj = HBDeconstructObject(hb_obj=roomsolid.rooms)  # -> faces, apertures, doors, shades; plug-in component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
number_slider = Slider(1, range=0..8)
cull_i = CullIndex(List=decnstrobj.faces, Indices=Slider(1, range=0..1), Wrap=True)
aperturesbyratio = HBAperturesByRatio(hb_objs=flatten(cull_i), ratio=windowratio_2)  # -> report, hb_objs; plug-in component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
facemodel = ClusterOutput(aperturesbyratio.hb_objs)
decnstrobj_2 = HBDeconstructObject(hb_obj=aperturesbyratio.hb_objs)  # -> faces, apertures, doors, shades; plug-in component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
verticalorhorizontal_3 = Data(verticalorhorizontal_2)
windowvisualtransmittance = ClusterInput()
angle_3 = Data(angle_2)
depth_3 = Data(depth_2)
flipstart_3 = Data(flipstart_2)
louvershades = HBLouverShades(
    hb_objs=flatten(decnstrobj_2.apertures),
    depth=depth_3,
    angle=angle_3,
    vertical=verticalorhorizontal_3,
    flip_start=flipstart_3)  # -> report, hb_objs; plug-in component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
windowvisualtransmittance_2 = Data(windowvisualtransmittance)
glassmod = HBGlassModifier(name="window", trans=windowvisualtransmittance_2)  # -> modifier; plug-in component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
vizall = HBVisualizeAll(hb_objs=flatten(decnstrobj_2.apertures))  # -> geo; plug-in component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
applywindowmod = HBApplyWindowModifier(hb_objs=flatten(louvershades.hb_objs), mod=glassmod)  # -> hb_objs; plug-in component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
aperturesgeometry = ClusterOutput(vizall)
aperturesmodel = ClusterOutput(applywindowmod)

# ==== cluster SouthWest
verticalorhorizontal = ClusterInput()
rooms = ClusterInput()
windowratio = ClusterInput()
name = ClusterInput()
legendpar = ClusterInput()
flipstart = ClusterInput()
depth = ClusterInput()
angle = ClusterInput()
verticalorhorizontal_2 = Data(verticalorhorizontal)
rooms_2 = Curve(rooms)
windowratio_2 = Data(windowratio)
name_2 = Data(name)
legendpar_2 = Data(legendpar)
flipstart_2 = Data(flipstart)
depth_2 = Data(depth)
angle_2 = Data(angle)
heightrooms = ClusterInput()
legendpar_3 = ClusterOutput(legendpar_2)
student1north = Curve(rooms_2)
heightrooms_2 = Data(heightrooms)
Z = UnitZ(Factor=heightrooms_2)
area = Area(Geometry=student1north)  # -> Area, Centroid
extr = Extrude(Base=student1north, Direction=Z)
opaqueintext = ClusterInput()
cap = CapHoles(Brep=extr)
ma = MassAddition(Input=area.Area)  # -> Result, PartialResults
opaqueintext_2 = Data(opaqueintext)
totalarea = Data(ma.Result)
roomsolid = HBRoomFromSolid(geo=flatten(cap), name=name_2, mod_set=opaqueintext_2, conditioned=True)  # -> report, rooms; plug-in component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
totalarea_2 = ClusterOutput(totalarea)
roomsmodel = ClusterOutput(roomsolid.rooms)
decnstrobj = HBDeconstructObject(hb_obj=roomsolid.rooms)  # -> faces, apertures, doors, shades; plug-in component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
number_slider = Slider(1, range=0..8)
cull_i = CullIndex(List=decnstrobj.faces, Indices=Slider(2, range=0..8), Wrap=True)
aperturesbyratio = HBAperturesByRatio(hb_objs=flatten(cull_i), ratio=windowratio_2)  # -> report, hb_objs; plug-in component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
facemodel = ClusterOutput(aperturesbyratio.hb_objs)
decnstrobj_2 = HBDeconstructObject(hb_obj=aperturesbyratio.hb_objs)  # -> faces, apertures, doors, shades; plug-in component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
verticalorhorizontal_3 = Data(verticalorhorizontal_2)
windowvisualtransmittance = ClusterInput()
angle_3 = Data(angle_2)
depth_3 = Data(depth_2)
flipstart_3 = Data(flipstart_2)
louvershades = HBLouverShades(
    hb_objs=flatten(decnstrobj_2.apertures),
    depth=depth_3,
    angle=angle_3,
    vertical=verticalorhorizontal_3,
    flip_start=flipstart_3)  # -> report, hb_objs; plug-in component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
windowvisualtransmittance_2 = Data(windowvisualtransmittance)
glassmod = HBGlassModifier(name="window", trans=windowvisualtransmittance_2)  # -> modifier; plug-in component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
vizall = HBVisualizeAll(hb_objs=flatten(decnstrobj_2.apertures))  # -> geo; plug-in component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
applywindowmod = HBApplyWindowModifier(hb_objs=flatten(louvershades.hb_objs), mod=glassmod)  # -> hb_objs; plug-in component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
aperturesgeometry = ClusterOutput(vizall)
aperturesmodel = ClusterOutput(applywindowmod)

# ==== cluster EastSouth1
verticalorhorizontal = ClusterInput()
rooms = ClusterInput()
windowratio = ClusterInput()
name = ClusterInput()
legendpar = ClusterInput()
flipstart = ClusterInput()
depth = ClusterInput()
angle = ClusterInput()
verticalorhorizontal_2 = Data(verticalorhorizontal)
rooms_2 = Curve(rooms)
windowratio_2 = Data(windowratio)
name_2 = Data(name)
legendpar_2 = Data(legendpar)
flipstart_2 = Data(flipstart)
depth_2 = Data(depth)
angle_2 = Data(angle)
heightrooms = ClusterInput()
legendpar_3 = ClusterOutput(legendpar_2)
student1north = Curve(rooms_2)
heightrooms_2 = Data(heightrooms)
Z = UnitZ(Factor=heightrooms_2)
area = Area(Geometry=student1north)  # -> Area, Centroid
extr = Extrude(Base=student1north, Direction=Z)
opaqueintext = ClusterInput()
cap = CapHoles(Brep=extr)
ma = MassAddition(Input=area.Area)  # -> Result, PartialResults
opaqueintext_2 = Data(opaqueintext)
totalarea = Data(ma.Result)
roomsolid = HBRoomFromSolid(geo=flatten(cap), name=name_2, mod_set=opaqueintext_2, conditioned=True)  # -> report, rooms; plug-in component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
totalarea_2 = ClusterOutput(totalarea)
roomsmodel = ClusterOutput(roomsolid.rooms)
decnstrobj = HBDeconstructObject(hb_obj=roomsolid.rooms)  # -> faces, apertures, doors, shades; plug-in component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
number_slider = Slider(1, range=0..8)
cull_i = CullIndex(List=decnstrobj.faces, Indices=Slider(4, range=0..8), Wrap=True)
aperturesbyratio = HBAperturesByRatio(hb_objs=flatten(cull_i), ratio=windowratio_2)  # -> report, hb_objs; plug-in component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
facemodel = ClusterOutput(aperturesbyratio.hb_objs)
decnstrobj_2 = HBDeconstructObject(hb_obj=aperturesbyratio.hb_objs)  # -> faces, apertures, doors, shades; plug-in component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
verticalorhorizontal_3 = Data(verticalorhorizontal_2)
windowvisualtransmittance = ClusterInput()
angle_3 = Data(angle_2)
depth_3 = Data(depth_2)
flipstart_3 = Data(flipstart_2)
louvershades = HBLouverShades(
    hb_objs=flatten(decnstrobj_2.apertures),
    depth=depth_3,
    angle=angle_3,
    vertical=verticalorhorizontal_3,
    flip_start=flipstart_3)  # -> report, hb_objs; plug-in component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
windowvisualtransmittance_2 = Data(windowvisualtransmittance)
glassmod = HBGlassModifier(name="window", trans=windowvisualtransmittance_2)  # -> modifier; plug-in component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
vizall = HBVisualizeAll(hb_objs=flatten(decnstrobj_2.apertures))  # -> geo; plug-in component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
applywindowmod = HBApplyWindowModifier(hb_objs=flatten(louvershades.hb_objs), mod=glassmod)  # -> hb_objs; plug-in component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
aperturesgeometry = ClusterOutput(vizall)
aperturesmodel = ClusterOutput(applywindowmod)

# ==== cluster SouthWest_2
verticalorhorizontal = ClusterInput()
rooms = ClusterInput()
windowratio = ClusterInput()
name = ClusterInput()
legendpar = ClusterInput()
flipstart = ClusterInput()
depth = ClusterInput()
angle = ClusterInput()
verticalorhorizontal_2 = Data(verticalorhorizontal)
rooms_2 = Curve(rooms)
windowratio_2 = Data(windowratio)
name_2 = Data(name)
legendpar_2 = Data(legendpar)
flipstart_2 = Data(flipstart)
depth_2 = Data(depth)
angle_2 = Data(angle)
heightrooms = ClusterInput()
legendpar_3 = ClusterOutput(legendpar_2)
student1north = Curve(rooms_2)
heightrooms_2 = Data(heightrooms)
Z = UnitZ(Factor=heightrooms_2)
area = Area(Geometry=student1north)  # -> Area, Centroid
extr = Extrude(Base=student1north, Direction=Z)
opaqueintext = ClusterInput()
cap = CapHoles(Brep=extr)
ma = MassAddition(Input=area.Area)  # -> Result, PartialResults
opaqueintext_2 = Data(opaqueintext)
totalarea = Data(ma.Result)
roomsolid = HBRoomFromSolid(geo=flatten(cap), name=name_2, mod_set=opaqueintext_2, conditioned=True)  # -> report, rooms; plug-in component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
totalarea_2 = ClusterOutput(totalarea)
roomsmodel = ClusterOutput(roomsolid.rooms)
decnstrobj = HBDeconstructObject(hb_obj=roomsolid.rooms)  # -> faces, apertures, doors, shades; plug-in component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
number_slider = Slider(1, range=0..8)
cull_i = CullIndex(List=decnstrobj.faces, Indices=Slider(3, range=0..8), Wrap=True)
aperturesbyratio = HBAperturesByRatio(hb_objs=flatten(cull_i), ratio=windowratio_2)  # -> report, hb_objs; plug-in component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
facemodel = ClusterOutput(aperturesbyratio.hb_objs)
decnstrobj_2 = HBDeconstructObject(hb_obj=aperturesbyratio.hb_objs)  # -> faces, apertures, doors, shades; plug-in component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
verticalorhorizontal_3 = Data(verticalorhorizontal_2)
windowvisualtransmittance = ClusterInput()
angle_3 = Data(angle_2)
depth_3 = Data(depth_2)
flipstart_3 = Data(flipstart_2)
louvershades = HBLouverShades(
    hb_objs=flatten(decnstrobj_2.apertures),
    depth=depth_3,
    angle=angle_3,
    vertical=verticalorhorizontal_3,
    flip_start=flipstart_3)  # -> report, hb_objs; plug-in component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
windowvisualtransmittance_2 = Data(windowvisualtransmittance)
glassmod = HBGlassModifier(name="window", trans=windowvisualtransmittance_2)  # -> modifier; plug-in component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
vizall = HBVisualizeAll(hb_objs=flatten(decnstrobj_2.apertures))  # -> geo; plug-in component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
applywindowmod = HBApplyWindowModifier(hb_objs=flatten(louvershades.hb_objs), mod=glassmod)  # -> hb_objs; plug-in component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
aperturesgeometry = ClusterOutput(vizall)
aperturesmodel = ClusterOutput(applywindowmod)
